% Simulink data dictionary app.sldd

V_AIN0_mV = Simulink.Signal(StorageClass="ExportedGlobal", DataType="uint16")
V_AIN1_mV = Simulink.Signal(StorageClass="ExportedGlobal", DataType="uint16")
V_AIN2_mV = Simulink.Signal(StorageClass="ExportedGlobal", DataType="uint16")
V_AIN3_mV = Simulink.Signal(StorageClass="ExportedGlobal", DataType="uint16")
N_byte1 = Simulink.Parameter(1, StorageClass="ExportedGlobal", DataType="uint8")
N_byte2 = Simulink.Parameter(1, StorageClass="ExportedGlobal", DataType="uint8")
N_byte3 = Simulink.Parameter(1, StorageClass="ExportedGlobal", DataType="uint8")
N_byte4 = Simulink.Parameter(1, StorageClass="ExportedGlobal", DataType="uint8")
N_byte5 = Simulink.Parameter(1, StorageClass="ExportedGlobal", DataType="uint8")
N_byte6 = Simulink.Parameter(1, StorageClass="ExportedGlobal", DataType="uint8")
N_byte7 = Simulink.Parameter(1, StorageClass="ExportedGlobal", DataType="uint8")
N_byte8 = Simulink.Parameter(1, StorageClass="ExportedGlobal", DataType="uint8")
N_CAN1 = Simulink.Signal(StorageClass="ExportedGlobal", DataType="uint8")
N_CAN2 = Simulink.Signal(StorageClass="ExportedGlobal", DataType="uint8")
N_CAN3 = Simulink.Signal(StorageClass="ExportedGlobal", DataType="uint8")
N_CAN4 = Simulink.Signal(StorageClass="ExportedGlobal", DataType="uint8")